# Grasshopper definition 025_robot_artist_grasshopper.ghx (Grasshopper 1.0.7)

reload = Button()

# ----
# Robot
load = Button()
python = PythonScript(load=load)  # -> robot
# ---------- python: Python ----------
from scriptcontext import sticky as st

import compas

from compas.robots import RobotModel
from compas.robots import GithubPackageMeshLoader
from compas_fab.ghpython import RobotArtist

# Robot meshes are usually in meters
# Set a high percision to prevent parsing errors
# and configure Rhino itself in meters
compas.PRECISION = '12f'

# Store robot in component-based key
robot_key = 'robot_{}'.format(str(ghenv.Component.InstanceGuid))

if robot_key not in st:
    st[robot_key] = None

if load:
    # Load robot (try other repo/package combinations, e.g. 'abb_irb120_support')
    repo    = 'ros-industrial/abb'
    package = 'abb_irb6600_support'
    branch  = 'kinetic-devel'

    github = GithubPackageMeshLoader(repo, package, branch)

    robot = RobotModel.from_urdf_file(github.load_urdf('irb6640.urdf'))
    robot.load_geometry(github)
    robot.artist = RobotArtist(robot)

    st[robot_key] = robot

robot = st[robot_key]
# ---------- end python ----------
robot = Data(python)

py = PythonScript(reload=reload)
# ---------- py: Python ----------
if reload:
    from compas_ghpython import unload_modules
    unload_modules('compas')
# ---------- end py ----------

# ---- group: forward kinematics
# Configuration
a1 = Slider(1, range=-360..360)
a2 = Slider(22, range=-360..360)
a3 = Slider(-27, range=-360..360)
a4 = Slider(-95, range=-360..360)
a5 = Slider(-11, range=-360..360)
a6 = Slider(40, range=-360..360)
forward_kinematics = PythonScript(robot=robot, a1=a1, a2=a2, a3=a3, a4=a4, a5=a5, a6=a6)  # -> configuration
# ---------- forward_kinematics: Python ----------
import math
from compas_fab.robots import Configuration

if robot:
    configuration = [a1, a2, a3, a4, a5, a6]
    configuration = Configuration.from_revolute_values([math.radians(a) for a in configuration])
# ---------- end forward_kinematics ----------

# ----
# Visualisation
list = ValueList({"forward_kinematics": 0, "inverse_kinematics": 1, "calculated_path": 2}, selected="forward_kinematics")
filter = StreamFilter(Gate=list, Stream0=forward_kinematics)
show_end_effector_frame = BooleanToggle(False)
show_base_frame = BooleanToggle(False)
show_collision = BooleanToggle(False)
show_visual = BooleanToggle(True)
show_axes = BooleanToggle(True)
visualize = PythonScript(
    robot=robot,
    configuration=filter,
    show_visual=show_visual,
    show_collision=show_collision,
    show_axes=show_axes,
    show_base_frame=show_base_frame,
    show_end_effector_frame=show_end_effector_frame)  # -> visual, collision, axes, axes_color, ee_frame, ee_color, base_frame, base_color
# ---------- visualize: Python ----------
from System.Drawing import Color

from compas.geometry import Vector
from compas.geometry import Point
from compas.geometry import Frame
from compas_ghpython import draw_pipes

from compas_fab.robots import Configuration

import compas_fab
print compas_fab.HERE

frames = []

size = .100
radius = .001

red = Color.FromArgb(255, 0, 0)
green = Color.FromArgb(0, 255, 0)
blue = Color.FromArgb(0, 0, 255)

frame_colors = [red, green, blue]

def pipes_from_frame(frame, size, radius):
    pipes = []
    for axis in [frame.xaxis, frame.yaxis, frame.zaxis]:
        pipe = {}
        pipe['points'] = [list(frame.point), list(Point(*frame.point) + Vector(*axis) * size)]
        pipe['radius'] = radius
        pipes.append(pipe)
    return pipes

if robot and configuration:
    print ('Setting robot configuration:')
    print (configuration)
    robot.artist.update(configuration, robot.get_configurable_joint_names(), visual=show_visual, collision=show_collision)

    if show_visual:
        visual = robot.artist.draw_visual()
    if show_collision:
        collision = robot.artist.draw_collision()
    
    joint_names = robot.get_configurable_joint_names()
    joint_state = dict(zip(joint_names, configuration.values))
    
    frames = robot.transformed_frames(joint_state)
    axes = robot.transformed_axes(joint_state)
    
    if show_axes:
        pipes = []
        axes_color = []
        for frame in frames:
            pipes += pipes_from_frame(frame, size, radius)
            axes_color += frame_colors
        axes = draw_pipes(pipes, cap=1)


    if show_end_effector_frame:
        ee_link_name = robot.get_end_effector_link_name()
        ee_frame = robot.forward_kinematics(joint_state, ee_link_name)
        ee_pipes = pipes_from_frame(ee_frame, size, radius)
        ee_frame = draw_pipes(ee_pipes, cap=1)
        ee_color = frame_colors

    if show_base_frame:
        link = robot.get_link_by_name(robot.get_base_link_name())
        if link.parent_joint:
            base_frame = link.parent_joint.origin.copy()
        else:
            base_frame = Frame.worldXY()
        base_pipes = pipes_from_frame(base_frame, size, radius)
        base_frame = draw_pipes(base_pipes, cap=1)
        base_color = frame_colors
# ---------- end visualize ----------
preview = CustomPreview(Geometry=visualize.axes, Shader=visualize.axes_color)
preview_2 = CustomPreview(Geometry=visualize.base_frame, Shader=visualize.base_color)
geo = Geometry(visualize.collision)
preview_3 = CustomPreview(Geometry=visualize.ee_frame, Shader=visualize.ee_color)
geo_2 = Geometry(visualize.visual)
